# Dynamo graph DSRevitNodesUI.WallLocation.dyn (Dynamo 3.6.2.11575)

wall_location = WallLocation("CoreExterior")
wall_types = WallTypes("Exterior - 9 7/8\" EIFS on Mtl. Stud")
select_face = DSFaceSelection()  # 1 picked in the model
byFace = Wall.ByFace(locationLine=wall_location, wallType=wall_types, surface=select_face)
