# Dynamo graph Forma.Analysis.Sun.GroundResult.dyn (Dynamo 3.4.1.7055)
# packages: DynamoFormaBeta 1.0.0

getSite = GetSiteHttp("{\"projectId\":\"pro_0piyim6e3w\",\"siteId\":\"pro_0piyim6e3w\",\"region\":\"US\"}")  # graph input
getAllElements = GetAllElementsHttp("{\"elements\":[{\"urn\":\"urn:adsk-forma-elements:proposal:pro_0piyim6e3w:fd2cb86f-74d1-44b1-af68-c95ce94650b4:1754666905923\",\"path\":\"root\",\"worldTransform\":[1,0,0,0,0,1,0,0,0,0,1,0,0,0,0,1]}],\"region\":\"US\"}")  # graph input
getAllElements_2 = GetAllElementsHttp("{\"elements\":[{\"urn\":\"urn:adsk-forma-elements:proposal:pro_0piyim6e3w:fd2cb86f-74d1-44b1-af68-c95ce94650b4:1754666905923\",\"path\":\"root\",\"worldTransform\":[1,0,0,0,0,1,0,0,0,0,1,0,0,0,0,1]}],\"region\":\"US\"}")  # graph input
properties = Forma.Elements.Element.Properties(element=getAllElements_2)
string = StringInput("category")
valueAtKey = DesignScript.Builtin.Dictionary.ValueAtKey(dictionary=properties, key=string)
string_2 = StringInput("proposal")
eq = valueAtKey == string_2
boolean = BoolSelector(true)
allIndicesOf = List.AllIndicesOf(list=eq, item=boolean)
getItemAtIndex = List.GetItemAtIndex(list=getAllElements, index=allIndicesOf)
URN = Forma.Elements.Element.URN(element=getItemAtIndex)
valueAtKey_2 = DesignScript.Builtin.Dictionary.ValueAtKey(dictionary=properties, key=string)
string_3 = StringInput("site_limit")
eq_2 = valueAtKey_2 == string_3
boolean_2 = BoolSelector(true)
allIndicesOf_2 = List.AllIndicesOf(list=eq_2, item=boolean_2)
getItemAtIndex_2 = List.GetItemAtIndex(list=getAllElements, index=allIndicesOf_2)
path = Forma.Elements.Element.Path(element=getItemAtIndex_2)
integer_slider = IntegerSlider(6, range=1..12 step 1)
integer_slider_2 = IntegerSlider(22, range=1..31 step 1)
runSunAnalysis = Forma.Analysis.Sun.RunSunAnalysis(site=getSite, rootUrn=URN, paths=path, month=integer_slider, date=integer_slider_2)
groundResult = Forma.Analysis.Sun.GroundResult(sun=runSunAnalysis)

# group: Using Sun.GroundResults
resolution = Forma.Analysis.SunGround.Resolution(sunGround=groundResult)
mask = Forma.Analysis.SunGround.Mask(sunGround=groundResult)
grid = Forma.Analysis.SunGround.Grid(sunGround=groundResult)
boundingBox = Forma.Analysis.SunGround.BoundingBox(sunGround=groundResult)
