# Dynamo graph Forma.Elements.Create.Building.BuildingByClosedCurve.dyn "5108292c-d50b-4011-a9a4-7f2d21acaad7" (Dynamo 3.4.1.7055)
# packages: DynamoFormaBeta 1.0.0

getSite = GetSiteHttp("{\"projectId\":\"pro_0piyim6e3w\",\"siteId\":\"pro_0piyim6e3w\",\"region\":\"US\"}")  # graph input
width = DoubleSlider(40, range=0..100 step 0.1)
length = DoubleSlider(30, range=0..100 step 0.1)
byWidthLength = Rectangle.ByWidthLength(width=width, length=length)
number_slider = DoubleSlider(10, range=0..100 step 0.1)
number_slider_2 = DoubleSlider(4, range=0..100 step 0.1)
string = StringInput("Residential")
buildingByClosedCurve = Custom[BuildingByClosedCurve](site=getSite, closedCurve=byWidthLength, floorHeight=number_slider, numberOfFloors=number_slider_2, functionId=string)  # package DynamoFormaBeta; Create a Building using a closed curve footprint
sendElementsToForma = SendElementsToForma(elements=buildingByClosedCurve)  # graph output
