# Dynamo graph Forma.Elements.Create.Building.BuildingByCurve.dyn "1b26bee6-8a26-4423-ac34-7c35cdd4946c" (Dynamo 3.4.1.7055)
# packages: DynamoFormaBeta 1.0.0

getSite = GetSiteHttp("{\"projectId\":\"pro_0piyim6e3w\",\"siteId\":\"pro_0piyim6e3w\",\"region\":\"US\"}")  # graph input
width = DoubleSlider(40, range=0..100 step 0.1)
byCoordinates = Point.ByCoordinates(x=width)
length = DoubleSlider(30, range=0..100 step 0.1)
byCoordinates_2 = Point.ByCoordinates(y=length)
list_create = List.Create(item0=byCoordinates, item1=byCoordinates_2)
byPoints = PolyCurve.ByPoints(points=list_create)
number_slider = DoubleSlider(10, range=0..100 step 0.1)
number_slider_2 = DoubleSlider(4, range=0..100 step 0.1)
length_2 = DoubleSlider(20, range=0..100 step 0.1)
string = StringInput("Residential")
buildingByCurve = Custom[BuildingByCurve](site=getSite, curve=byPoints, floorHeight=number_slider, numberOfFloors=number_slider_2, width=length_2, functionId=string)  # package DynamoFormaBeta; Create a building using a center line curve.
sendElementsToForma = SendElementsToForma(elements=buildingByCurve)  # graph output
