# Dynamo graph Forma.Elements.Create.Constraints.ByClosedCurveAndHeight .dyn "7ff20064-aadc-42e1-8848-1bbec5dee9e0" (Dynamo 3.4.1.7055)
# packages: DynamoFormaBeta 1.0.0

getSite = GetSiteHttp("{\"projectId\":\"pro_0piyim6e3w\",\"siteId\":\"pro_0piyim6e3w\",\"region\":\"US\"}")  # graph input
width = DoubleSlider(40, range=0..100 step 0.1)
length = DoubleSlider(30, range=0..100 step 0.1)
byWidthLength = Rectangle.ByWidthLength(width=width, length=length)
width_2 = DoubleSlider(20, range=0..100 step 0.1)
byClosedCurveAndHeight = Custom[ByClosedCurveAndHeight](site=getSite, curve=byWidthLength, height=width_2)  # package DynamoFormaBeta; Create a 2.5d constraint by a closed curve and a height
sendElementsToForma = SendElementsToForma(elements=byClosedCurveAndHeight)  # graph output
