# Dynamo graph Forma.Elements.Create.Road.ByCurve.dyn "6ea11acb-08e1-49e4-a9d6-236c7751cc33" (Dynamo 3.4.1.7055)
# packages: DynamoFormaBeta 1.0.0

getSite = GetSiteHttp("{\"projectId\":\"pro_0piyim6e3w\",\"siteId\":\"pro_0piyim6e3w\",\"region\":\"US\"}")  # graph input
width = DoubleSlider(40, range=0..100 step 0.1)
byCoordinates = Point.ByCoordinates(x=width)
length = DoubleSlider(30, range=0..100 step 0.1)
byCoordinates_2 = Point.ByCoordinates(y=length)
list_create = List.Create(item0=byCoordinates, item1=byCoordinates_2)
byPoints = PolyCurve.ByPoints(points=list_create)
byCurve = Custom[ByCurve](site=getSite, curve=byPoints)  # package DynamoFormaBeta; Create a road based on a line curve.
sendElementsToForma = SendElementsToForma(elements=byCurve)  # graph output
