# Dynamo graph Forma.Elements.Create.SiteLimit.ByClosedCurve .dyn "3199c17d-9261-4780-8d64-f78c268f4de7" (Dynamo 3.4.1.7055)
# packages: DynamoFormaBeta 1.0.0

getSite = GetSiteHttp("{\"projectId\":\"pro_0piyim6e3w\",\"siteId\":\"pro_0piyim6e3w\",\"region\":\"US\"}")  # graph input
width = DoubleSlider(40, range=0..100 step 0.1)
length = DoubleSlider(30, range=0..100 step 0.1)
byWidthLength = Rectangle.ByWidthLength(width=width, length=length)
byClosedCurve = Custom[ByClosedCurve](project=getSite, curve=byWidthLength)  # package DynamoFormaBeta; Create a Site Limit by a closed curve.
sendElementsToForma = SendElementsToForma(elements=byClosedCurve)  # graph output
