# Dynamo graph Forma.Elements.System.BasicBuilding.ByCurve.dyn (Dynamo 3.4.1.7055)
# packages: DynamoFormaBeta 1.0.0

getSite = GetSiteHttp("{\"projectId\":\"pro_0piyim6e3w\",\"siteId\":\"pro_0piyim6e3w\",\"region\":\"US\"}")  # graph input
width = DoubleSlider(40, range=0..100 step 0.1)
length = DoubleSlider(30, range=0..100 step 0.1)
byWidthLength = Rectangle.ByWidthLength(width=width, length=length)
string = StringInput("Residential")
string_2 = StringInput("LIVING_UNIT")
empty = List.Empty()
byCurve = Forma.Elements.System.BasicBuilding.ByCurve(closedCurve=byWidthLength, functionId=string, program=string_2, holes=empty)
byUnits = Forma.Elements.System.BasicBuilding.ByUnits(units=byCurve)
number_slider = DoubleSlider(10, range=0..100 step 0.1)
byCoordinates = Point.ByCoordinates()
byOrigin = CoordinateSystem.ByOrigin(origin=byCoordinates)
byPlans = Forma.Elements.System.BasicBuilding.ByPlans(site=getSite, plans=byUnits, floorHeigts=number_slider, coordinateSystem=byOrigin)
sendElementsToForma = SendElementsToForma(elements=byPlans)  # graph output
