# Dynamo graph Forma.Representations.TerrainShape.ByCurve.dyn (Dynamo 3.4.1.7055)
# packages: DynamoFormaBeta 1.0.0

getSite = GetSiteHttp("{\"projectId\":\"pro_0piyim6e3w\",\"siteId\":\"pro_0piyim6e3w\",\"region\":\"US\"}")  # graph input
width = DoubleSlider(40, range=0..100 step 0.1)
length = DoubleSlider(30, range=0..100 step 0.1)
byWidthLength = Rectangle.ByWidthLength(width=width, length=length)
getTerrain = GetTerrainHttp("{\"elements\":[{\"urn\":\"urn:adsk-forma-elements:terrain:pro_0piyim6e3w:ec9a9b8c-3c1c-417b-8dfd-a7d771fd5375:1754576844791\",\"path\":\"root/7f98e87d-2dd0-42b5-9647-1982325e8ddd\",\"worldTransform\":[1,0,0,0,0,1,0,0,0,0,1,0,0,0,0,1]}],\"region\":\"US\"}")  # graph input
terrainShape = Forma.Elements.Element.TerrainShape(elements=getTerrain)
byCurve = Forma.Representations.TerrainShape.ByCurve(site=getSite, curve=byWidthLength, fillColor=terrainShape.fillColor, fillOpacity=terrainShape.fillOpacity, strokeColor=terrainShape.strokeColor, strokeLineWidth=terrainShape.strokeLineWidth)
