# Dynamo graph Revit.Elements.CurtainSystem.ByFace.dyn (Dynamo 3.6.2.11575)

select_face = DSFaceSelection()  # 1 picked in the model
string = StringInput("5' x 10'")
byName = CurtainSystemType.ByName(name=string)
byFace = CurtainSystem.ByFace(face=select_face, curtainSystemType=byName)
