# Dynamo graph Revit.Elements.CurtainSystemType.Name.dyn (Dynamo 3.4.1.7055)

element_classes = ElementTypes("CurtainSystemType")
all_elements_of_class = ElementsOfType(element_class=element_classes)
name = CurtainSystemType.Name(curtainSystemType=all_elements_of_class)
