# Dynamo graph Revit.Elements.CurveByPoints.ByReferencePoints.dyn (Dynamo 3.6.2.11575)

point_1_x = DoubleSlider(0, range=0..100 step 0.1)
point_1_y = DoubleSlider(0, range=0..100 step 0.1)
point_1_z = DoubleSlider(0, range=0..100 step 0.1)
byCoordinates = ReferencePoint.ByCoordinates(x=point_1_x, y=point_1_y, z=point_1_z)
point_2_x = DoubleSlider(10, range=0..100 step 0.1)
point_2_y = DoubleSlider(5, range=0..100 step 0.1)
point_2_z = DoubleSlider(0, range=0..100 step 0.1)
byCoordinates_2 = ReferencePoint.ByCoordinates(x=point_2_x, y=point_2_y, z=point_2_z)
point_3_x = DoubleSlider(20, range=0..100 step 0.1)
point_3_y = DoubleSlider(0, range=0..100 step 0.1)
point_3_z = DoubleSlider(5, range=0..100 step 0.1)
byCoordinates_3 = ReferencePoint.ByCoordinates(x=point_3_x, y=point_3_y, z=point_3_z)
list_create = List.Create(item0=byCoordinates, item1=byCoordinates_2, item2=byCoordinates_3)
is_periodic = BoolSelector(false)
byReferencePoints = CurveByPoints.ByReferencePoints(points=list_create, isReferenceLine=is_periodic)
watch = Watch(byReferencePoints)
