# Dynamo graph Revit.Elements.Element.GetGeometry.dyn (Dynamo 3.6.2.11575)

select_model_element = DSModelElementSelection()  # 1 picked in the model
string = StringInput("Fine")
getGeometry = Element.GetGeometry(element=select_model_element, detailLevel=string)
volume = Solid.Volume(solid=getGeometry)
boundingBox = Geometry.BoundingBox(geometry=getGeometry)
