# Dynamo graph Revit.Elements.Element.Subelements.dyn (Dynamo 3.6.2.11575)

categories = Categories("OST_StairsRailing")
all_elements_of_category = ElementsOfCategory(Category=categories)
subelements = Element.Subelements(element=all_elements_of_category)
