# Dynamo graph Revit.Elements.FamilyInstance.Transform.dyn (Dynamo 3.6.2.11575)
# Family Instance Transform Demonstration - Shows how to use the FamilyInstance.Transform node to move and rotate Revit family instances using coordinate systems

select_model_element = DSModelElementSelection()  # 1 picked in the model
byOrigin = CoordinateSystem.ByOrigin()
x_offset = DoubleInput(5)
z_offset = DoubleInput(15)
byOrigin_2 = CoordinateSystem.ByOrigin(x=x_offset, y=z_offset)
byCoordinates = Point.ByCoordinates(x=x_offset, y=z_offset)
XAxis = Vector.XAxis()
number = DoubleInput(30)
rotate = CoordinateSystem.Rotate(coordinateSystem=byOrigin_2, origin=byCoordinates, axis=XAxis, degrees=number)
transform = FamilyInstance.Transform(familyInstance=select_model_element, fromCoordinateSystem=byOrigin, contextCoordinateSystem=rotate)
