# Dynamo graph Revit.Elements.Floor.MovePoint.dyn (Dynamo 3.6.2.11575)

floor_width = DoubleInput(10)
floor_length = DoubleInput(8)
byWidthLength = Rectangle.ByWidthLength(width=floor_width, length=floor_length)
floor_type_name = StringInput("Generic - 12\"")
byName = FloorType.ByName(name=floor_type_name)
floor_elevation = DoubleInput(0)
byElevation = Level.ByElevation(elevation=floor_elevation)
byOutlineTypeAndLevel = Floor.ByOutlineTypeAndLevel(outline=byWidthLength, floorType=byName, level=byElevation)
gate = Gate(false, byOutlineTypeAndLevel)
points = Floor.Points(floor=gate)
watch = Watch(points)
number = DoubleInput(1)
count = List.Count(list=points)
number_2 = DoubleInput(1)
range = Range(start=number, end=count, step=number_2)
movePoint = Floor.MovePoint(floor=gate, point=points, offset=range)
points_2 = Floor.Points(floor=movePoint)
watch_2 = Watch(points_2)
