# Dynamo graph Revit.Elements.ForgeType.TypeId.dyn (Dynamo 3.6.2.11575)

available_spectypes = SpecTypes("autodesk.spec.aec:length")
typeId = ForgeType.TypeId(forgeType=available_spectypes)
isValidObject = ForgeType.IsValidObject(forgeType=available_spectypes)
