# Dynamo graph Revit.Elements.ImportInstance.ByGeometriesAndView.dyn (Dynamo 3.6.2.11575)

origin = Point.Origin()
sphere_radius = DoubleInput(5)
byCenterPointRadius = Sphere.ByCenterPointRadius(centerPoint=origin, radius=sphere_radius)
cuboid_length = DoubleInput(10)
cuboid_width = DoubleInput(8)
cuboid_height = DoubleInput(6)
byLengths = Cuboid.ByLengths(width=cuboid_length, length=cuboid_width, height=cuboid_height)
list_create = List.Create(item0=byCenterPointRadius, item1=byLengths)
views = Views("{3D}")
byGeometriesAndView = ImportInstance.ByGeometriesAndView(geometries=list_create, view=views)
