# Dynamo graph Revit.Elements.ImportInstance.BySATFile.dyn (Dynamo 3.6.2.11575)
# ImportInstance.BySATFile Demonstration - A comprehensive example showing how to import 3D geometry from SAT files into Revit using Dynamo, including analysis of the imported geometry properties.

sat_file_path = Filename("C:\Users\Steve\Documents\ADSK\Snowdon Towers Sample Architectural - 3D View - {3D}.sat")
bySATFile = ImportInstance.BySATFile(pathToFile=sat_file_path)
geometry = Element.Geometry(element=bySATFile)
boundingBox = Element.BoundingBox(element=bySATFile)
