# Dynamo graph Revit.Elements.ImportInstance.Path.dyn (Dynamo 3.6.2.11575)

sat_file_path = Filename("C:\Program Files\Autodesk\Snowdon Towers Sample Architectural - 3D View - {3D}.sat")
bySATFile = ImportInstance.BySATFile(pathToFile=sat_file_path)
path = ImportInstance.Path(importInstance=bySATFile)
