# Dynamo graph Revit.Elements.LinkInstance.ByTitle.dyn (Dynamo 3.6.2.11575)

allElementsOfCategoryInView = LinkInstance.AllElementsOfCategoryInView()  # unwired: linkInstance, category, view
byName = LinkInstance.ByName()  # unwired: name
string = StringInput("Snowdon Towers Sample Structural")
byTitle = LinkInstance.ByTitle(title=string)
document = LinkInstance.Document(linkInstance=byTitle)
document_2 = LinkInstance.Document()  # unwired: linkInstance
getLocation = LinkElement.GetLocation(linkedElement=byTitle)
allElementsAtLevel = LinkInstance.AllElementsAtLevel()  # unwired: linkInstance, level
categories = Categories("OST_StructuralFraming")
allElementsOfCategory = LinkInstance.AllElementsOfCategory(linkInstance=byTitle, category=categories)
category = FamilyDocument.Category()  # unwired: familyDocument
