# Dynamo graph Revit.Elements.ModelText.ByTextSketchPlaneAndPosition.dyn (Dynamo 3.6.2.11575)
# Demonstrates how to create 3D model text in Revit using the ModelText.ByTextSketchPlaneAndPosition node. This graph shows all the required inputs: text content, sketch plane for orientation, XYZ positioning coordinates, and model text type for formatting. Model text appears as a 3D element in the model space, visible from multiple views unlike regular text annotations.

string = StringInput("DYNAMO TEXT")
XY = Plane.XY()
byPlane = SketchPlane.ByPlane(plane=XY)
x_position = DoubleInput(0)
y_position = DoubleInput(0)
z_position = DoubleInput(10)
text_type_name = StringInput("Model Text 1")
byName = ModelTextType.ByName(name=text_type_name)
byTextSketchPlaneAndPosition = ModelText.ByTextSketchPlaneAndPosition(text=string, sketchPlane=byPlane, xCoordinateInPlane=x_position, yCoordinateInPlane=y_position, textDepth=z_position, modelTextType=byName)
