# Dynamo graph Revit.Elements.PathOfTravel.InsertWayPoint.dyn (Dynamo 3.6.2.11575)

select_model_element = DSModelElementSelection()  # 1 picked in the model
number = DoubleInput(2)
byCoordinates = Point.ByCoordinates(x=number)
number_2 = DoubleInput(1)
insertWayPoint = PathOfTravel.InsertWayPoint(pathOfTravel=select_model_element, wayPoint=byCoordinates, index=number_2)
getWayPoints = PathOfTravel.GetWayPoints(pathOfTravel=insertWayPoint)
getWayPoints_2 = PathOfTravel.GetWayPoints(pathOfTravel=select_model_element)
