# Dynamo graph Revit.Elements.PathOfTravel.RemoveWayPoint.dyn (Dynamo 3.6.2.11575)

select_model_element = DSModelElementSelection()  # 1 picked in the model
number = DoubleInput(2)
removeWayPoint = PathOfTravel.RemoveWayPoint(pathOfTravel=select_model_element, index=number)
getWayPoints = PathOfTravel.GetWayPoints(pathOfTravel=removeWayPoint)
getWayPoints_2 = PathOfTravel.GetWayPoints(pathOfTravel=select_model_element)
