# Dynamo graph Revit.Elements.PathOfTravel.SetWayPoint.dyn (Dynamo 3.6.2.11575)

select_model_element = DSModelElementSelection()  # 1 picked in the model
number = DoubleInput(3)
byCoordinates = Point.ByCoordinates(x=number)
number_2 = DoubleInput(1)
setWayPoint = PathOfTravel.SetWayPoint(pathOfTravel=select_model_element, newPosition=byCoordinates, index=number_2)
getWayPoints = PathOfTravel.GetWayPoints(pathOfTravel=setWayPoint)
getWayPoints_2 = PathOfTravel.GetWayPoints(pathOfTravel=select_model_element)
