# Dynamo graph Revit.Elements.ReferencePoint.ByLengthOnCurveReference.dyn (Dynamo 3.6.2.11575)
# Demonstrates ReferencePoint.ByLengthOnCurveReference node functionality. Creates a model curve and places reference points at specific distances along it. Note: This only works in Revit Family Documents, not project documents.

number = DoubleInput(0)
number_2 = DoubleInput(0)
byCoordinates = Point.ByCoordinates(x=number, y=number_2)
number_3 = DoubleInput(100)
number_4 = DoubleInput(0)
byCoordinates_2 = Point.ByCoordinates(x=number_3, y=number_4)
byStartPointEndPoint = Line.ByStartPointEndPoint(startPoint=byCoordinates, endPoint=byCoordinates_2)
byCurve = ModelCurve.ByCurve(curve=byStartPointEndPoint)
elementCurveReference = CurveElement.ElementCurveReference(curveElement=byCurve)
number_5 = DoubleInput(25)
byLengthOnCurveReference = ReferencePoint.ByLengthOnCurveReference(elementCurveReference=elementCurveReference, length=number_5)
number_6 = DoubleInput(50)
byLengthOnCurveReference_2 = ReferencePoint.ByLengthOnCurveReference(elementCurveReference=elementCurveReference, length=number_6)
number_7 = DoubleInput(75)
byLengthOnCurveReference_3 = ReferencePoint.ByLengthOnCurveReference(elementCurveReference=elementCurveReference, length=number_7)
