# Dynamo graph Revit.Elements.ReferencePoint.ByParameterOnCurveReference.dyn (Dynamo 3.6.2.11575)

number = DoubleInput(0)
number_2 = DoubleInput(0)
byCoordinates = Point.ByCoordinates(x=number, y=number_2)
number_3 = DoubleInput(100)
number_4 = DoubleInput(0)
byCoordinates_2 = Point.ByCoordinates(x=number_3, y=number_4)
byStartPointEndPoint = Line.ByStartPointEndPoint(startPoint=byCoordinates, endPoint=byCoordinates_2)
byCurve = ModelCurve.ByCurve(curve=byStartPointEndPoint)
elementCurveReference = CurveElement.ElementCurveReference(curveElement=byCurve)
number_slider = DoubleSlider(0.5, range=0..1 step 0.1)
byParameterOnCurveReference = ReferencePoint.ByParameterOnCurveReference(elementCurveReference=elementCurveReference, parameter=number_slider)
