# Dynamo graph Revit.Elements.ReferencePoint.ByPointVectorDistance.dyn (Dynamo 3.6.2.11575)
# Demonstration of Revit.Elements.ReferencePoint.ByPointVectorDistance node - Creates a Revit Reference Point by specifying a starting point, direction vector, and distance along that vector.

number = DoubleInput(0)
number_2 = DoubleInput(0)
byCoordinates = Point.ByCoordinates(x=number, y=number_2)
number_3 = DoubleInput(1)
number_4 = DoubleInput(0)
number_5 = DoubleInput(1)
byCoordinates_2 = Vector.ByCoordinates(x=number_3, y=number_4, z=number_5)
number_6 = DoubleInput(10)
byPointVectorDistance = ReferencePoint.ByPointVectorDistance(basePoint=byCoordinates, direction=byCoordinates_2, distance=number_6)
