# Dynamo graph Revit.Elements.Roof.ByOutlineExtrusionTypeAndLevel.dyn (Dynamo 3.6.2.11575)

number = DoubleInput(40)
number_2 = DoubleInput(20)
number_3 = DoubleInput(5)
byCoordinates = Point.ByCoordinates(x=number, y=number_2, z=number_3)
byCoordinates_2 = Point.ByCoordinates(x=number, y=number)
list_create = List.Create(item0=byCoordinates, item1=byCoordinates_2)
boolean = BoolSelector(false)
byPoints = PolyCurve.ByPoints(points=list_create, connectLastToFirst=boolean)
roof_types = RoofTypes("Concrete - 6\"")
levels = Levels("R3")
byCoordinates_3 = Point.ByCoordinates(x=number, y=number)
byStartPointEndPoint = Line.ByStartPointEndPoint(startPoint=byCoordinates, endPoint=byCoordinates_3)
byLine = ReferencePlane.ByLine(line=byStartPointEndPoint)
number_4 = DoubleInput(125)
number_5 = DoubleInput(150)
byOutlineExtrusionTypeAndLevel = Roof.ByOutlineExtrusionTypeAndLevel(outline=byPoints, roofType=roof_types, level=levels, plane=byLine, extrusionStart=number_4, extrusionEnd=number_5)
