# Dynamo graph FormaNodesWorkingFile-01.dyn (Dynamo 3.4.1.7055)
# packages: DynamoFormaBeta 1.0.0

# note: User Error Handling

# group: already complete
components = Forma.Site.Site.Components()  # unwired: site
getAllElements = GetAllElementsHttp("")  # graph input
getSite = GetSiteHttp("")  # graph input
getTerrain = GetTerrainHttp("")  # graph input
selectElements = SelectElementsHttp("")  # graph input
byCurve = Forma.Representations.Footprint.ByCurve()  # unwired: site, curve
byUnits = Forma.Representations.GFAUnits.ByUnits()  # unwired: gfaUnits
byCurveAndElevation = Forma.Representations.GFAUnits.ByCurveAndElevation()  # unwired: closedCurve
byMeshOrSolid = Forma.Representations.VolumeMesh.ByMeshOrSolid()  # unwired: site, meshOrSolid
setTransform = Forma.Elements.Element.SetTransform()  # unwired: element, coordinateSystem
children = Forma.Elements.Element.Children()  # unwired: element
footprint = Forma.Elements.Element.Footprint()  # unwired: elements
getAllChildren = Forma.Elements.Element.GetAllChildren()  # unwired: element
GFAUnits = Forma.Elements.Element.GFAUnits()  # unwired: elements
hasRepresentation = Forma.Elements.Element.HasRepresentation()  # unwired: element, key
path = Forma.Elements.Element.Path()  # unwired: element
properties = Forma.Elements.Element.Properties()  # unwired: element
terrainShape = Forma.Elements.Element.TerrainShape()  # unwired: elements
URN = Forma.Elements.Element.URN()  # unwired: element
volume25DCollection = Forma.Elements.Element.Volume25DCollection()  # unwired: elements
volumeMesh = Forma.Elements.Element.VolumeMesh()  # unwired: elements
byClosedCurve = Forma.Elements.System.Basic.ByClosedCurve()  # unwired: site, closedCurve
byClosedCurveAndHeight = Forma.Elements.System.Basic.ByClosedCurveAndHeight()  # unwired: site, closedCurve, height
byCurve_2 = Forma.Elements.System.Basic.ByCurve()  # unwired: site, curve
byRepresentations = Forma.Elements.System.Integrate.ByRepresentations()  # unwired: site, reperesentations
elevationAt = Forma.Elements.System.Terrain.ElevationAt()  # unwired: terrain, x, y
runSunAnalysis = Forma.Analysis.Sun.RunSunAnalysis()  # unwired: site, rootUrn, paths, month, date
sunHours = Forma.Analysis.Sun.SunHours()  # unwired: sun

# group: Not sure where to start here
byUrn = Forma.Elements.Element.ByUrn()  # unwired: site, urn

byCurve_3 = Forma.Representations.TerrainShape.ByCurve()  # unwired: site, curve

# group: what is elevations going to do here?
byCurveHeightAndElevation = Forma.Representations.Volume25DCollection.ByCurveHeightAndElevation()  # unwired: site, closedCurves, heights, elevations

# group: not sure what to do here (Element.Transform)
getSite_2 = GetSiteHttp("{\"projectId\":\"pro_0piyim6e3w\",\"siteId\":\"pro_0piyim6e3w\",\"region\":\"US\"}")  # graph input
width = DoubleSlider(40, range=0..100 step 0.1)
length = DoubleSlider(30, range=0..100 step 0.1)
byWidthLength = Rectangle.ByWidthLength(width=width, length=length)
byClosedCurve_2 = Custom[ByClosedCurve](project=getSite_2, curve=byWidthLength)  # package DynamoFormaBeta; Create a Site Limit by a closed curve.
sendElementsToForma = SendElementsToForma(elements=byClosedCurve_2)  # graph output
transform = Forma.Elements.Element.Transform(element=byClosedCurve_2)

# group: working (good for examples)
getSite_3 = GetSiteHttp("{\"projectId\":\"pro_0piyim6e3w\",\"siteId\":\"pro_0piyim6e3w\",\"region\":\"US\"}")  # graph input
width_2 = DoubleSlider(40, range=0..100 step 0.1)
length_2 = DoubleSlider(30, range=0..100 step 0.1)
byWidthLength_2 = Rectangle.ByWidthLength(width=width_2, length=length_2)
width_3 = DoubleSlider(20, range=0..100 step 0.1)
byClosedCurveAndHeight_2 = Custom[ByClosedCurveAndHeight](site=getSite_3, curve=byWidthLength_2, height=width_3)  # package DynamoFormaBeta; Create a 2.5d constraint by a closed curve and a height
sendElementsToForma_2 = SendElementsToForma(elements=byClosedCurveAndHeight_2)  # graph output

# group: BasicBuilding.ByFloors
# Not sure what elevation is doing
getSite_4 = GetSiteHttp("{\"projectId\":\"pro_0piyim6e3w\",\"siteId\":\"pro_0piyim6e3w\",\"region\":\"US\"}")  # graph input
width_4 = DoubleSlider(40, range=0..100 step 0.1)
length_3 = DoubleSlider(30, range=0..100 step 0.1)
byWidthLength_3 = Rectangle.ByWidthLength(width=width_4, length=length_3)
number_slider = DoubleSlider(10, range=0..100 step 0.1)
string = StringInput("Residential")
number_slider_2 = DoubleSlider(4, range=0..100 step 0.1)
byFloors = Forma.Elements.System.BasicBuilding.ByFloors(site=getSite_4, closedCurveFloors=byWidthLength_3, floorHeights=number_slider, functionIds=string, elevation=number_slider_2)
sendElementsToForma_3 = SendElementsToForma(elements=byFloors)  # graph output

getSite_5 = GetSiteHttp("{\"projectId\":\"pro_0piyim6e3w\",\"siteId\":\"pro_0piyim6e3w\",\"region\":\"US\"}")  # graph input
width_5 = DoubleSlider(40, range=0..100 step 0.1)
length_4 = DoubleSlider(30, range=0..100 step 0.1)
byWidthLength_4 = Rectangle.ByWidthLength(width=width_5, length=length_4)
getTerrain_2 = GetTerrainHttp("{\"elements\":[{\"urn\":\"urn:adsk-forma-elements:terrain:pro_0piyim6e3w:ec9a9b8c-3c1c-417b-8dfd-a7d771fd5375:1754576844791\",\"path\":\"root/7f98e87d-2dd0-42b5-9647-1982325e8ddd\",\"worldTransform\":[1,0,0,0,0,1,0,0,0,0,1,0,0,0,0,1]}],\"region\":\"US\"}")  # graph input
terrainShape_2 = Forma.Elements.Element.TerrainShape(elements=getTerrain_2)
byCurve_4 = Forma.Representations.TerrainShape.ByCurve(site=getSite_5, curve=byWidthLength_4, fillColor=terrainShape_2.fillColor, fillOpacity=terrainShape_2.fillOpacity, strokeColor=terrainShape_2.strokeColor, strokeLineWidth=terrainShape_2.strokeLineWidth)
